# Grasshopper definition TestBettaComponent.gh (Grasshopper 1.0.7)
# plug-ins: Bacillus

number_slider = Slider(234, range=0..1000)
number_slider_2 = Slider(123, range=0..1000)
construct_point = ConstructPoint(XCoordinate=0, YCoordinate=0, ZCoordinate=0)
merge = Merge(Data1=number_slider, Data2=number_slider_2, Data3=Slider(98, range=0..100))  # -> flatten(Result)
testcircle = Circle(Plane=PlaneXY(0, 0, 0), Radius=1)
testln = Line(StartPoint=Point(0, 0, 0), EndPoint=Point(1, -5, 3))
bacillus = Bacillus(List=merge, Value145=number_slider, Value245=number_slider_2, TestString="hello", PointTest=construct_point)
testlineoutput = Line(testln)
testcircleoutput = Circle(testcircle)
