# Grasshopper definition betta_showcase.gh (Grasshopper 1.0.8)

# ---- group: Process List
pl_operation = ValueList({"square", "sqrt", "double", "half"}, selected="square")
pl_numbers = Panel("""3
1
4
1
5
9""")
process_list = ProcessList(Numbers=pl_numbers, Operation=pl_operation)
process_list_out = Panel(process_list)

# ---- group: Add Values
av_points = AVPoints([Point(0, 0, 0), Point(1, 1, 0)])
av_numbers = Panel("""1
2
3
4
5""")
av_value_a = Slider(10, range=0..100)
av_value_b = Slider(20, range=0..100)
av_text = Panel("betta")
add_values = AddValues(Numbers=av_numbers, ValueA=av_value_a, ValueB=av_value_b, Text=av_text, Points=av_points)
add_values_out = Panel(add_values)

# ---- group: Create Circle Info
ci_center = CICenter(Point(0, 0, 0))
ci_radius = Slider(5, range=1..20)
create_circle_info = CreateCircleInfo(Center=ci_center, Radius=ci_radius)  # -> Output1, Output2, Output3
create_circle_info_out1 = Panel(create_circle_info.Output1)
create_circle_info_out2 = Panel(create_circle_info.Output2)
create_circle_info_out3 = Panel(create_circle_info.Output3)

# ---- group: Add 100
add100_input = Slider(42, range=0..100)
add_100 = Add100(Input=add100_input)
add_100_out = Panel(add_100)

# ---- group: Get Statistics
gs_numbers = Panel("""3
1
4
1
5
9
2
6""")
get_statistics = GetStatistics(Numbers=gs_numbers)  # -> Mean, Median, StandardDeviation, Min, Max, Count
get_statistics_mean = Panel(get_statistics.Mean)
get_statistics_median = Panel(get_statistics.Median)
get_statistics_standarddeviation = Panel(get_statistics.StandardDeviation)
get_statistics_min = Panel(get_statistics.Min)
get_statistics_max = Panel(get_statistics.Max)
get_statistics_count = Panel(get_statistics.Count)

# ---- group: Delayed Echo
de_message = Panel("hello betta")
de_seconds = Slider(3.6, range=0..5)
delayed_echo = DelayedEcho(Message=de_message, Seconds=de_seconds)
delayed_echo_out = Panel(delayed_echo)

# ---- group: Upper
upper_text = Panel("betta")
upper = Upper(Text=upper_text)
upper_out = Panel(upper)

# ---- group: Lower
lower_text = Panel("BETTA")
lower = Lower(Text=lower_text)
lower_out = Panel(lower)

# ---- group: Reverse
reverse_text = Panel("betta")
reverse = Reverse(Text=reverse_text)
reverse_out = Panel(reverse)

# ---- group: Length
length_text = Panel("betta")
length = Length(Text=length_text)
length_out = Panel(length)

# ---- group: Concat
concat_left = Panel("fish")
concat_right = Panel("tank")
concat_separator = Panel(" - ")
concat = Concat(Left=concat_left, Right=concat_right, Separator=concat_separator)
concat_out = Panel(concat)

# ---- group: Midpoint
mid_a = MidA(Point(0, 0, 0))
mid_b = MidB(Point(4, 2, 0))
midpoint = Midpoint(A=mid_a, B=mid_b)
midpoint_out = Panel(midpoint)

# ---- group: Circle
circle_center = CircleCenter(Point(0, 0, 0))
circle_radius = Slider(3, range=1..20)
circle = Circle(Center=circle_center, Radius=circle_radius)
circle_out = Panel(circle)

# ---- group: Divide Circle
div_center = DivCenter(Point(0, 0, 0))
div_radius = Slider(11, range=1..20)
div_count = Slider(12, range=1..36)
divide_circle = DivideCircle(Center=div_center, Radius=div_radius, Count=div_count)
divide_circle_out = Panel(divide_circle)

# ---- group: Line Info
line = Line(Line((0, 0, 0), (5, 3, 0)))
line_info = LineInfo(Line=line)  # -> Mid, Length
line_info_mid = Panel(line_info.Mid)
line_info_length = Panel(line_info.Length)

# ---- group: Double
double_x = Slider(3, range=-10..10)
double = Double(X=double_x)
double_out = Panel(double)

# ---- group: Power
power_base = Slider(2, range=0..10)
power_exp = Slider(3, range=0..10)
power = Power(Base=power_base, Exponent=power_exp)
power_out = Panel(power)

# ---- group: Sum
sum_numbers = Panel("""1
2
3
4""")
sum = Sum(Numbers=sum_numbers)
sum_out = Panel(sum)

# ---- group: Series
series_count = Slider(5, range=0..20)
series = Series(Count=series_count)
series_out = Panel(series)

# ---- group: MinMax
minmax_numbers = Panel("""3
1
4
1
5""")
minmax = MinMax(Numbers=minmax_numbers)  # -> Min, Max
minmax_min = Panel(minmax.Min)
minmax_max = Panel(minmax.Max)

# ---- group: Slow Square
slowsq_value = Slider(4, range=0..12)
slow_square = SlowSquare(Value=slowsq_value)
slow_square_out = Panel(slow_square)

# ---- group: Negate
negate_x = Slider(1, range=-10..10)
negate = Negate(Value=negate_x)
negate_out = Panel(negate)

# ---- group: Clamp01
clamp_x = Slider(2, range=-1..3)
clamp01 = Clamp01(Value=clamp_x)
clamp01_out = Panel(clamp01)

# ---- group: Remap
remap_v = Slider(5, range=0..10)
remap_s0 = Slider(0, range=0..10)
remap_s1 = Slider(10, range=0..10)
remap_t0 = Slider(0, range=0..100)
remap_t1 = Slider(100, range=0..100)
remap = Remap(Value=remap_v, SourceMin=remap_s0, SourceMax=remap_s1, TargetMin=remap_t0, TargetMax=remap_t1)
remap_r = Panel(remap)
